# Grasshopper definition RoadOnMesh.gh (Grasshopper 1.0.7)
# plug-ins: Pufferfish, Bifocals

curve = Curve(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)
mesh = Mesh(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)
# 221206
meshroadsz221205 = CSharpScript(
    road=curve,
    pathdivisionratio=Slider(1, range=0..10),
    mesh=mesh,
    roadwidth=Slider(4, range=0..100),
    slopewidth=Slider(2, range=0..100),
    fixmesh=Toggle(True))  # -> out, ResultOriginalmMeshTopology, ResultRoadVerticesTopology, RoadMesh, RoadCentercrv, SlopeMesh, debug; inputs road: Curve, pathdivisionratio: Double, mesh: Mesh, roadwidth: Double, slopewidth: Double, fixmesh: Boolean
# ---------- meshroadsz221205: C# ----------
    Rhino.Geometry.Collections.MeshVertexList meshvertex = mesh.Vertices;
    Rhino.Geometry.Collections.MeshFaceList meshface = mesh.Faces;
    Rhino.Geometry.Polyline[] polylines = mesh.GetNakedEdges();
    double nakededgelengthsum = 0;
    double nakededgeelementssum = 0;
    roadwidth = roadwidth * 0.5d;

    if( pathdivisionratio == 0)
    {
      pathdivisionratio = 1d;
    }

    Rhino.Geometry.Mesh Orimesh = new Rhino.Geometry.Mesh();
    Rhino.Geometry.Mesh remainmesh = new Rhino.Geometry.Mesh();
    Rhino.Geometry.Mesh cullmesh = new Rhino.Geometry.Mesh();

    foreach (var polyline in polylines)
    {
      nakededgelengthsum += polyline.Length;
      nakededgeelementssum += polyline.Count;
    }

    //rebuild crv with similar vertex density *pathdivisionratio
    Curve rebuiltcrv = road.Rebuild((int) (road.GetLength() / (((nakededgelengthsum / nakededgeelementssum) / pathdivisionratio))), (int) 3, true);

    //out put the road crv
    RoadCentercrv = rebuiltcrv;

    List<bool> vertexwithinditance = new List<bool>();
    double t;

    //mesh vertex closest pt to road crv
    List<int> cullfaceindex = new List<int>();
    for (int i = 0; i < meshvertex.Count; i++)
    {
      rebuiltcrv.ClosestPoint(meshvertex[i], out t);
      Point3d ptonpath = rebuiltcrv.PointAt(t);
      Point3d temppt = rebuiltcrv.PointAt(t);
      temppt.Z = 0;
      Point3d meshvertexflatz = meshvertex[i];
      meshvertexflatz.Z = 0;

      // Making Road
      if (temppt.DistanceTo(meshvertexflatz) < roadwidth)
      {
        //get cull mesh start
        int[] tempindex = mesh.Vertices.GetVertexFaces(i);
        for (int j = 0; j < tempindex.Length; j++)
        {
          if (!cullfaceindex.Contains(tempindex[j]))
          {
            cullfaceindex.Add(tempindex[j]);
          }
        }


        Orimesh.Vertices.Add(new Point3d(meshvertex[i].X, meshvertex[i].Y, ptonpath.Z));
      }
        // Making Slope
      else if(temppt.DistanceTo(meshvertexflatz) < (roadwidth + slopewidth))
      {
        double ratio = Math.Cos(((temppt.DistanceTo(meshvertex[i]) - roadwidth) / slopewidth) * Math.PI) * 0.5f + 0.5f;
        Orimesh.Vertices.Add(new Point3d(meshvertex[i].X, meshvertex[i].Y, ptonpath.Z * ratio + meshvertex[i].Z * (1 - ratio)));

        //get cull mesh start
        int[] tempindex = mesh.Vertices.GetVertexFaces(i);
        for (int j = 0; j < tempindex.Length; j++)
        {
          if (!cullfaceindex.Contains(tempindex[j]))
          {
            cullfaceindex.Add(tempindex[j]);
          }
        }
        //get cull mesh end
      }
        //Rest of mesh
      else{
        Orimesh.Vertices.Add(meshvertex[i]);
      }
      remainmesh.Vertices.Add(meshvertex[i]);
      cullmesh.Vertices.Add(meshvertex[i]);
    }
    for (int i = 0; i < meshface.Count; i++)
    {
      if (!cullfaceindex.Contains(i))
      {
        remainmesh.Faces.AddFace(meshface[i]);
      }
      else
      {
        cullmesh.Faces.AddFace(meshface[i]);
      }
      Orimesh.Faces.AddFace(meshface[i]);
    }

    Orimesh.FaceNormals.ComputeFaceNormals();
    Orimesh.Normals.ComputeNormals();
    Orimesh.Compact();

    remainmesh.FaceNormals.ComputeFaceNormals();
    remainmesh.Normals.ComputeNormals();
    remainmesh.Compact();

    cullmesh.FaceNormals.ComputeFaceNormals();
    cullmesh.Normals.ComputeNormals();
    cullmesh.Compact();

    ResultOriginalmMeshTopology = Orimesh;


    //get cullmehs boundary pt
    Rhino.Geometry.Polyline[] cullmeshedgepolyline = cullmesh.GetNakedEdges();
    //offset path

    NurbsCurve crv = new NurbsCurve(rebuiltcrv.ToNurbsCurve()); //input curve to use as offset base
    Plane xy = new Plane(Point3d.Origin, Vector3d.ZAxis);
    Rhino.Geometry. Curve[] offsetcrvpositive = crv.Offset(xy, roadwidth, 0.01, 0); //Get the offset curve array
    Rhino.Geometry. Curve[] offsetcrvnegative = crv.Offset(xy, -roadwidth, 0.01, 0); //Get the offset curve array
    List<NurbsCurve> crv3 = new List<NurbsCurve>(); //Make a new array with the size of offsetcrvpositive.count
    for (int i = 0; i < offsetcrvpositive.Length; i++)
    {
      crv3.Add(new NurbsCurve(offsetcrvpositive[i].ToNurbsCurve())); //Convert each Curve into a NurbyCurvey
    }
    for (int i = 0; i < offsetcrvnegative.Length; i++)
    {
      crv3.Add(new NurbsCurve(offsetcrvnegative[i].ToNurbsCurve())); //Convert each Curve into a NurbyCurvey
    }


    Rhino.Geometry.Mesh roadmesh = new Mesh();
    //get Raod crv division pts for delaunay road mesh
    List<Point3d> rebuiltcrvdivisionpt = new List<Point3d> ();
    List<Point3d> rebuiltcrvdivisionpt2df = new List<Point3d> ();
    for (int i = 0; i < crv3.Count; i++)
    {
      double[] rebuiltcrvdivision = crv3[i].DivideByLength(nakededgelengthsum / nakededgeelementssum / pathdivisionratio, false);

      for (int j = 0; j < rebuiltcrvdivision.Length; j++)
      {
        rebuiltcrvdivisionpt.Add(crv3[i].PointAt(rebuiltcrvdivision[j]));
        rebuiltcrvdivisionpt2df.Add(new Point3f((float) crv3[i].PointAt(rebuiltcrvdivision[j]).X, (float) crv3[i].PointAt(rebuiltcrvdivision[j]).Y, 0));
      }
    }

    //make delaunay road mesh
    List<Point3d> delaunaypt = new List<Point3d>();

    for (int i = 0; i < cullmeshedgepolyline.Length; i++)
    {
      var temp = cullmeshedgepolyline[i].ToArray();
      for (int j = 0; j < temp.Length; j++)
      {
        delaunaypt.Add(temp[j]);
      }
      //for loop add path pts
      for (int k = 0; k < rebuiltcrvdivisionpt.Count; k++)
      {
        delaunaypt.Add(rebuiltcrvdivisionpt[k]);
      }
    }
    //make delaunay
    Rhino.Geometry.Mesh delMesh = new Mesh();
    Rhino.Geometry.Mesh delMeshculled = new Mesh();

    Grasshopper.Kernel.Geometry.Node2List nodes = new Grasshopper.Kernel.Geometry.Node2List();
    for(int i = 0; i < delaunaypt.Count; i++)
    {
      nodes.Append(new Grasshopper.Kernel.Geometry.Node2(delaunaypt[i].X, delaunaypt[i].Y));
      delMeshculled.Vertices.Add(delaunaypt[i]);
      roadmesh.Vertices.Add(delaunaypt[i]);
    }

    var faces = new List<Grasshopper.Kernel.Geometry.Delaunay.Face>();

    faces = Grasshopper.Kernel.Geometry.Delaunay.Solver.Solve_Faces(nodes, 1);
    delMesh = Grasshopper.Kernel.Geometry.Delaunay.Solver.Solve_Mesh(nodes, 1, ref faces);

    double tolerance = 0.001d;


    //trim road delaunay mesh faces
    for (int i = 0; i < delMesh.Faces.Count; i++)
    {
      Point3f[] temppt = new Point3f[4];
      delMesh.Faces.GetFaceVertices(i, out temppt[0], out temppt[1], out temppt[2], out temppt[3]);
      Point3d temppt3d0 = Point3d.FromPoint3f(temppt[0]);
      Point3d temppt3d1 = Point3d.FromPoint3f(temppt[1]);
      Point3d temppt3d2 = Point3d.FromPoint3f(temppt[2]);


      if (rebuiltcrvdivisionpt2df.Contains(temppt[0]) &&
        rebuiltcrvdivisionpt2df.Contains(temppt[1]) &&
        rebuiltcrvdivisionpt2df.Contains(temppt[2]))
      {
        //add output road mesh
        roadmesh.Faces.AddFace(delMesh.Faces[i]);

      }
      else
      {
        //try three sample pts can be projected to the remainmesh
        //add output slope mesh
        Point3d[] testppt = new Point3d[4];
        testppt[0] = temppt3d0 + tolerance * ((temppt3d1 + temppt3d2) / 2d - temppt3d0);
        testppt[1] = temppt3d1 + tolerance * ((temppt3d0 + temppt3d2) / 2d - temppt3d1);
        testppt[2] = temppt3d2 + tolerance * ((temppt3d1 + temppt3d0) / 2d - temppt3d2);


        var prj_points0 = Rhino.Geometry.Intersect.Intersection.ProjectPointsToMeshes(new[] {remainmesh}, new[] {testppt[0]}, Vector3d.ZAxis, tolerance / 10);
        var prj_points1 = Rhino.Geometry.Intersect.Intersection.ProjectPointsToMeshes(new[] {remainmesh}, new[] {testppt[1]}, Vector3d.ZAxis, tolerance / 10);
        var prj_points2 = Rhino.Geometry.Intersect.Intersection.ProjectPointsToMeshes(new[] {remainmesh}, new[] {testppt[2]}, Vector3d.ZAxis, tolerance / 10);

        //debug = prj_points0;
        bool ispt0inside = prj_points0.Length == 0;
        bool ispt1inside = prj_points1.Length == 0;
        bool ispt2inside = prj_points2.Length == 0;

        if(ispt0inside && ispt1inside && ispt2inside)
        {
          delMeshculled.Faces.AddFace(delMesh.Faces[i]);
        }
      }
    }
    //}

    //output
    delMeshculled.FaceNormals.ComputeFaceNormals();
    delMeshculled.Normals.ComputeNormals();
    delMeshculled.Compact();
    delMeshculled.RebuildNormals();
    SlopeMesh = delMeshculled;

    roadmesh.FaceNormals.ComputeFaceNormals();
    roadmesh.Normals.ComputeNormals();
    roadmesh.Compact();
    roadmesh.RebuildNormals();

    RoadMesh = roadmesh;



    Rhino.Geometry.Mesh finaloutputmesh = new Rhino.Geometry.Mesh();
    finaloutputmesh.Append(remainmesh);
    finaloutputmesh.Append(delMeshculled);
    finaloutputmesh.Append(roadmesh);

    if (fixmesh)//fill hole
    {

      roadmesh.ExtractNonManifoldEdges(true);
      roadmesh.CollapseFacesByArea(0.01d,0d);
      roadmesh.Faces.CullDegenerateFaces();

      finaloutputmesh.Faces.CullDegenerateFaces();

    }
    finaloutputmesh.RebuildNormals();
    ResultRoadVerticesTopology = finaloutputmesh;
# ---------- end meshroadsz221205 ----------
boolean_toggle = BooleanToggle(True)
mesh_2 = Mesh(meshroadsz221205.ResultRoadVerticesTopology)
curve_2 = Curve(meshroadsz221205.RoadCentercrv)
geometry = Geometry(meshroadsz221205.RoadMesh)
rebuild_mesh = RebuildMesh(
    Mesh=mesh_2,
    RebuildNormals=boolean_toggle,
    CullUnused=boolean_toggle,
    UnifyNormals=boolean_toggle,
    FlipNormals=False,
    IdenticalCombine=False,
    WeldVertices=0)
custom_preview = CustomPreview(
    Geometry=geometry,
    Material={diffuse=RGB(221, 160, 221), emission=RGB(66, 48, 66), shine=0.5, specular=RGB(255, 255, 255), transparency=0})
deconstruct_mesh = DeconstructMesh(Mesh=rebuild_mesh)  # -> Vertices, Faces, Colours, Normals
unit_z = UnitZ(Factor=1)
angle = Angle(VectorA=deconstruct_mesh.Normals, VectorB=unit_z)  # -> Angle, Reflex
remap_numbers = RemapNumbers(Value=angle.Angle, Source=" 0 to 0.5*pi", Target=Domain(0, 1))  # -> Mapped, Clipped
gradient = Gradient(
    LowerLimit=0,
    UpperLimit=1,
    Parameter=remap_numbers.Mapped,
    stops=[0: RGB(0, 128, 0), 0.5: RGB(255, 255, 0), 1: RGB(255, 0, 0)])
mesh_colours = MeshColours(Mesh=rebuild_mesh, Colours=gradient)
